# Grasshopper definition Basics.gh (Grasshopper 1.0.7)
# plug-ins: GH_CPython, Human

path = FilePath("C:\OpenModelica\share\doc\omc\testmodels\")
quicktest = GH_CPython()  # -> output
#   port output: indicate your output description here. refers to a new line.
# ---------- quicktest: Python ----------
import OMPython, modelica_language, modelicalang, pymoca, pyfmu, buildingspy, impactlib

from OMPython import OMCSessionZMQ
output = []
omc = OMCSessionZMQ()
output.append(omc.sendExpression("getVersion()"))
output.append(omc.sendExpression("loadModel(Modelica)"))
output.append(omc.sendExpression("loadFile(getInstallationDirectoryPath() + \"/share/doc/omc/testmodels/BouncingBall.mo\")"))
output.append(omc.sendExpression("instantiateModel(BouncingBall)"))
output.append(omc.sendExpression("simulate(BouncingBall, stopTime=3.0)"))
output.append(omc.sendExpression("val(h , 2.0)"))

output_ = '\n'.join(map(str, output))
# ---------- end quicktest ----------
# TODO
# Where simulation files end up?
# Copy .mo file into new working directory and run simulation there.
# Open .mat file
# Implement more functions...
panel = Panel("/")
rep = ReplaceText(Text=path, Find="\", Replace=panel, RecursiveReplace=False)
# Import and test libraries
panel_2 = Panel(quicktest)
# Get .mo file and file name
folder = Panel(rep)
dir = DirectoryContents(FolderPath=rep, Filter="*.mo", IncludeSubfolders=False)  # -> FilePaths, FileNames
entwine = Entwine(Branch00=dir.FilePaths, Branch01=dir.FileNames, FlattenInputs=True)  # -> simplify(Result)
item = ListItem(List=entwine, Index=Slider(0, range=0..10), Wrap=True)
panel_3 = Panel(item)
bang = ExplodeTree(Data=item)  # -> Branch0, Branch1
# Read Class
readclass = ReadMoFile(ModelPath=bang.Branch0, ClassName=bang.Branch1)  # -> output; inputs ClassName: list
#   port ModelPath: [required] - [type = int] - [default = None] Descripe your input here * bullet point. * bullet point
#   port output: indicate your output description here. refers to a new line.
# ---------- readclass: Python ----------
from OMPython import OMCSessionZMQ  

omc = OMCSessionZMQ()
omc.sendExpression("loadFile(" + '"' + ModelPath +'")')
#print("loadFile(" + '"' + ModelPath +'")') #Print Expression
output = omc.sendExpression("instantiateModel("+ClassName+")")
# ---------- end readclass ----------
# Simulate model
simulateclass = GH_CPython(ModelPath=bang.Branch0, ClassName=bang.Branch1, RunSimulation=Toggle(True))  # -> ModelPath, Quantities, SimOptions, Solutions; inputs ModelPath: list, ClassName: list, RunSimulation: list
# ---------- simulateclass: Python ----------
from OMPython import ModelicaSystem

#Input Model
mod=ModelicaSystem(ModelPath,ClassName) #2 arguments
#mod=ModelicaSystem(ModelPath, ClassName, ["Modelica"]) #3 arguments 
#mod=ModelicaSystem(ModelPath, ClassName, commandLineOptions="-d=newInst") #4 arguments

#Outputs
Quantities = mod.getQuantities()
SimOptions = mod.getSimulationOptions()
if RunSimulation == True:
    mod.simulate()
    Solutions = list(mod.getSolutions())
else:
    Solutions = mod.getSolutions()
# ---------- end simulateclass ----------
panel_4 = Panel(readclass)
data = Data(simulateclass.SimOptions)
keyvalues = GhPythonScript(dict=data)  # -> out, keys, values
# ---------- keyvalues: Python ----------
__author__ = "amd"
__version__ = "2020.07.06"

dict = eval(dict)
keys = []
values = []
for key, value in dict.items():
    keys.append(key)
    values.append(value)
# ---------- end keyvalues ----------
solutions = Panel(simulateclass.Solutions)
simulation_options_dictionary = Panel(data)
quantities = Panel(simulateclass.Quantities)
list = ItemSelector(keyvalues.keys, {"tolerance", "stopTime", "solver", "stepSize", "startTime"}, selected="tolerance")
getvaluebykey = GhPythonScript(dict=data, key=list)  # -> out, value
# ---------- getvaluebykey: Python ----------
__author__ = "amd"
__version__ = "2020.07.06"

dict = eval(dict)
value = dict.get(key)
# ---------- end getvaluebykey ----------
panel_5 = Panel(getvaluebykey.value)
